# Grasshopper definition Agripv_Mobile_ SimuSimp.gh (Grasshopper 1.0.7)

# Dossier de stockage des simulations.
# bien vérifier qu'ile xiste un dossier pour chaque angle de -60 à 60, nommer par leur angle seuls.
# Puis coler le chemin d'accès au dossier référencer en tant que "ANGLE" ci contre :
panel = Panel("C:\Users\maceo.valente\Documents\Automatisation\TEST_MVA\ANGLE")
# Indiquer les cacracétistiques structurelle du projet :
# 1 . L'orientation des panneaux selon l'axe des rang ( N =0, S =180, E 90, O -90)
# 2. La hauteur de l'axe d'attache des panneaux
# 3. L'entraxe PV
# 4. La taille du rampant.
orientation = Slider(45, range=-180..180)

# ----
# Orientation parcelle
radians = Radians(Degrees=orientation)
# Faire tourner l'axe y autour de l'axe z avec les degrés correspondant à l'orientationd de la parcelle
xy_plane = XYPlane(Origin=Point(0, 0, 0))
unit_z = UnitZ(Factor=1)
deconstruct_plane = DeconstructPlane(Plane=xy_plane)  # -> Origin, XAxis, YAxis, ZAxis
rotate = Rotate(Vector=deconstruct_plane.YAxis, Axis=unit_z, Angle=radians)

hauteur_en_m = Slider(3, range=0..100)
entraxe_pv = Slider(2.5, range=0..10)
# Avant de lancer la simulation.
# Bien vérifier la validiter :
# - du fichier météo
# - du format de la structure sur le volet 3D
# - =des caracétristiques projets
# - du fichier de dépôt des simulation sous le format ".../ANGLE/".
# 
# Attention, lors de la première simulation le contenu peut être bloqué par le système interne, il faut alors débloquer le contenu sur la fenètre qui s'affiche une fois la simulation lancée et eventuellement la relancer.
rampant_en_m = Slider(1.134, range=0..10)
# Référencer le fichier météo epw .
# 1. Clic droit sur "File Path"
# 2. Cliquer sur "Select existing file"
# 3. Selectionner le fichier epw ranger dans le dossier projet
# 4.Puis cliquer sur ouvrir
file_path = FilePath("C:\Users\maceo.valente\Documents\Automatisation\TEST_MVA\FRA_AC_Agen-La.Garenne.AP.075240_TMYx\FRA_AC_Agen-La.Garenne.AP.075240_TMYx.epw")
lancement_de_la_simulation_de_lumière = BooleanToggle(False)

# ----
# Taux de couverture
number_slider = Slider(20, range=0..100)
# créer une surface dans rhino ?
surface = Surface(<surface referenced from the Rhino model>)
rotate_2 = Rotate(Geometry=surface, Angle=radians, Plane=xy_plane)  # -> Geometry, Transform
division = Division(A="100", B=entraxe_pv)
unit_z_2 = UnitZ(Factor=hauteur_en_m)
divide_surface = DivideSurface(Surface=rotate_2.Geometry, UCount=division, VCount=number_slider)  # -> Points, Normals, Parameters
move = Move(Geometry=divide_surface.Points, Motion=unit_z_2)  # -> Geometry, Transform
construct_plane = ConstructPlane(Origin=move.Geometry, XAxis=Vector(1, 0, 0), YAxis=Vector(0, 1, 0))
align_plane = AlignPlane(Plane=construct_plane, Direction=rotate)  # -> Plane, Angle

deplane = DeconstructPlane(Plane=align_plane.Plane)  # -> Origin, XAxis, YAxis, ZAxis
rad = Radians(Degrees=Slider(-27, range=-60..60))
# Orientation autour de l'axe Y
construct_plane_2 = ConstructPlane(Origin=deplane.Origin, XAxis=deplane.ZAxis, YAxis=deplane.YAxis)
rotate_3 = Rotate(Geometry=align_plane.Plane, Angle=rad, Plane=construct_plane_2)  # -> Geometry, Transform

# ----
# Création et remplissage et taille des panneaux
number_slider_2 = Slider(5, range=0..100)
rectangle = Rectangle(Plane=rotate_3.Geometry, XSize=number_slider_2, YSize=rampant_en_m, Radius=0)  # -> Rectangle, Length
boundary_surfaces = BoundarySurfaces(Edges=rectangle.Rectangle)
brep = Brep(boundary_surfaces)

importepw = LBImportEPW(epw_file=file_path)  # -> location, dry_bulb_temperature, dew_point_temperature, relative_humidity, wind_speed, wind_direction, direct_normal_rad, diffuse_horizontal_rad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; plug-in component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
# https://docs.mcneel.com/rhino/7/help/fr-fr/toolbarmap/grasshopper_toolbar.htm
number_slider_3 = Slider(1, range=1..30)
# Surface de mesure de la simulation, surface d'étude au centre pour limiter les effets de bord.
srf = Surface(<surface referenced from the Rhino model>)
# Pas forcément besoin ; peut être utile pour vérifier
sunpath = LBSunPath(location=importepw.location, scale=1)  # -> report, vectors, altitudes, azimuths, hoys, sun_pts, analemma, daily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; plug-in component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
analysisperiod = LBAnalysisPeriod(
    start_month=Slider(1, range=1..12),
    start_day=Slider(1, range=1..30),
    start_hour=Slider(8, range=0..23),
    end_month=Slider(1, range=1..12),
    end_day=number_slider_3,
    end_hour=Slider(9, range=0..23))  # -> period, hoys, dates; plug-in component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
# A quelle distance de la surface de mesure on récolte les data
number_slider_4 = Slider(0.5, range=0..1)
number_slider_5 = Slider(1, range=0..1)
panel_2 = Panel("Finesse")
panel_3 = Panel("global skymatrix")
skymatrix = LBCumulativeSkyMatrix(location=importepw.location, direct_rad=importepw.direct_normal_rad, diffuse_rad=importepw.diffuse_horizontal_rad)  # -> report, sky_mtx; plug-in component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
toggle = BooleanToggle(False)
toggle_2 = BooleanToggle(True)
panel_4 = Panel("hourly skymatrix")
skymatrix_2 = LBCumulativeSkyMatrix(
    location=importepw.location,
    direct_rad=importepw.direct_normal_rad,
    diffuse_rad=importepw.diffuse_horizontal_rad,
    hoys=analysisperiod.hoys)  # -> report, sky_mtx; plug-in component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
incidentradiation = LBIncidentRadiation(
    sky_mtx=skymatrix.sky_mtx,
    geometry=flatten(srf),
    grid_size=number_slider_5,
    offset_dist=number_slider_4,
    irradiance=toggle,
    run=toggle_2)  # -> out, points, results, total, mesh, legend, title, int_mtx; plug-in component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
panel_5 = Panel("Sans contexte")
# 2 params de sortie :
# Moyenne d'irradiance horaire par point
# OU cumulé irradiance sur la surface à l'année
# 
# régler ça dans input : irradiance_
# idéalement, récupérer min, max et moy irradiance /heure
incidentradiation_2 = LBIncidentRadiation(
    sky_mtx=skymatrix.sky_mtx,
    geometry=flatten(srf),
    context=flatten(brep),
    grid_size=number_slider_5,
    offset_dist=number_slider_4,
    irradiance=toggle,
    run=toggle_2)  # -> out, points, results, total, mesh, legend, title, int_mtx; plug-in component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
panel_6 = Panel("Avec contexte")
rtrad = LBRealTimeIncidentRadiation(int_mtx=incidentradiation.int_mtx, sky_mtx=skymatrix_2.sky_mtx)  # -> results; plug-in component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
# Pour comparer des données similaires : LB Analysis Period à rentrer dans hoys (réaliser tout le processus sur 2h d'un jour en particulier
rtrad_2 = LBRealTimeIncidentRadiation(int_mtx=incidentradiation_2.int_mtx, sky_mtx=skymatrix_2.sky_mtx)  # -> results; plug-in component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
panel_7 = Panel(rtrad)
panel_8 = Panel(incidentradiation.results)
# LB Real Time Incident Radiation module !
panel_9 = Panel(rtrad_2)
